% Simulink data dictionary SiEngineDD.sldd

AccPwrbp = [0 1.5]
AccSpdbp = [300 750]
AfrStoich = 14.6
TimeCnstECP = 0.125
TimeCnstICP = 0.125
ans = "L:\\Bauto\\matlab\\toolbox\\autoblks\\autodemos\\projectsrc\\SI\\Plant\\SiEngineDD.sldd"
f_twc_eff_co = [0.17 0.25 0.45 0.99 0.99 0.99 0.99]
f_twc_eff_hc = [0.21 0.375 0.75 0.98 0.98 0.98 0.98]
f_twc_eff_lam = [0.909090909 0.944055944 0.979020979 1 1.013986014 1.048951049 1.083916084]
f_twc_eff_nox = [0.98 0.98 0.98 0.97 0.05 0.02 0]